# Grasshopper definition сервер.gh (Grasshopper 1.0.7)

websocket_client_start = WebsocketClientStart(Address="ws://172.20.10.6/ws", InitalMessage="Hello World", Reset=Button())
trigger = Trigger(Interval=100, TimerInterval=100, Target=websocket_client_sender)
websocket_client_receiver = WebsocketClientReceiver(WebsocketObjects=websocket_client_start, AutoUpdate=True)  # -> Message, Status
websocket_client_sender = WebsocketClientSender(WebsocketObjects=websocket_client_start, Message="{\"r\":\"100\",\"g\":\"0\",\"b\":\"0\"}")
python = GhPythonScript(text=websocket_client_receiver.Message)  # -> out, height
# ---------- python: Python ----------
import json

sensors = json.loads(text)
ptr = int(sensors['s1'])

if ptr > 2048:
    height = 100
else:
    height = -100
# ---------- end python ----------
panel = Panel(websocket_client_receiver.Message)
cir = Circle(Plane=PlaneXY(0, 0, 0), Radius=1)
panel_2 = Panel(python.height)
Z = UnitZ(Factor=python.height)
extr = Extrude(Base=cir, Direction=Z)
